# Grasshopper definition CW4.0_WP1_Form_Finding.gh (Grasshopper 1.0.7)
# plug-ins: NGon

number_slider = Slider(17, range=0..100)
Z = UnitZ(Factor=number_slider)
rectangle = Rectangle(Plane=PlaneXY(0, 0, 0), XSize=Slider(114, range=20..2000), YSize=Slider(104, range=0..140), Radius=0)  # -> Rectangle, Length
extr = Extrude(Base=rectangle.Rectangle, Direction=Z)
cap = CapHoles(Brep=extr)
rot3d = Rotate3D(
    Geometry=cap,
    Angle=degrees(Slider(0, range=0..45)),
    Center=Point(0, 0, 0),
    Axis=Vector(206.8690586, 288.6243865, 137.3901748))  # -> Geometry, Transform

slider = Slider(18, range=1..80)
vb = VBScript(genelist="GeneList B", count=slider)  # -> out, A
# ---------- vb: VB ----------
    For Each obj As IGH_DocumentObject In owner.OnPingDocument().Objects
      If (obj.ComponentGuid <> New Guid("{21553c44-ea62-475e-a8bb-62b2a3ee5ca5}")) Then Continue For
      If (obj.NickName Like genelist) Then
        CallByName(obj, "Count", CallType.Set, count)
        'CallByName(obj, "ExpireSolution", CallType.Method, False)
        Return
      End If
    Next

    Print("No matching Gene list object found")
# ---------- end vb ----------
vb_2 = VBScript(genelist="GeneList A", count=slider)  # -> out, A; same code as vb
vb_3 = VBScript(genelist="GeneList C", count=slider)  # -> out, A; same code as vb

series = Series(Start=0, Step=Slider(30, range=0..100), Count=slider)
pt = ConstructPoint(XCoordinate=0, YCoordinate=expr("x*2", Slider(100, range=0..100)), ZCoordinate=0)
Y = UnitY(Factor=series)
move = Move(Geometry=pt, Motion=Y)  # -> Geometry, Transform

genelist_b = GeneList(
    Decimals=2,
    Maximum=25,
    Minimum=10,
    Value=[12.48219925, 13.64573692, 22.7750513, 12.76645456, 18.12732119, 22.14067313, 17.78322127, 17.93184489, 18.91403729, 16.8279939, 15.34994088, 12.13705599, 12.80041446, 17.01246151, 12.02849041, 19.09019556, 14.68747525, 21.90331455])
genelist_a = GeneList(
    Decimals=2,
    Maximum=120,
    Minimum=80,
    Value=[111.3102076, 103.2107252, 86.96327333, 112.9429802, 99.04002382, 105.0836732, 108.771607, 92.75854516, 108.0282043, 106.5698115, 112.3726957, 104.8864909, 84.98164784, 102.3067295, 118.5429876, 90.42943586, 118.6820002, 117.2736124])
genelist_c = GeneList(
    Decimals=2,
    Maximum=10,
    Minimum=2,
    Value=[6.064079708, 5.990697483, 3.610917476, 6.210833451, 8.798714529, 6.729594222, 2.296228055, 4.139771705, 5.492087206, 6.287153291, 6.117133485, 5.912095932, 7.462301018, 6.414674813, 6.714176515, 6.963384061, 3.082834013, 4.800504485])

rectangle_2 = Rectangle(Plane=move.Geometry, XSize=genelist_a, YSize=genelist_b, Radius=0)  # -> Rectangle, Length
boxrec = BoxRectangle(Rectangle=rectangle_2.Rectangle, Height=genelist_c)
crv = Curve([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])
python = GhPythonScript(
    wood_from_db=boxrec,
    design_boundary=rot3d.Geometry,
    edge_index=1,
    height=number_slider,
    heights=genelist_c,
    srf_index=5,
    line_segment=crv)  # -> evaluated_points, all_blocks, packed_indecies, packed_selection, linear_selection, normal, linear_indecies, available_length; inputs wood_from_db: list, edge_index: Int32, heights: list, srf_index: Int32, line_segment: list
# ---------- python: Python ----------
__author__ = "Javid Jooshesh, j.jooshesh@hva.nl"
__version__ = "v1"

import ghpythonlib.treehelpers as th
import rhinoscriptsyntax as rs
import Grasshopper.Kernel.Data as ghp
import Grasshopper.Kernel.Geometry.Plane as gh_plane


class Blocks:
    """_Class representing the wood plank geometries from the database_
    Attributes:
        source (DataTree[Breps]) : The list of box breps as a Grasshopper
            datatree
    Methods:
        explode_polysrf: ...
        explode_srf: ...
        get_block_length: ...
        get_block_width: ...
    """

    def __init__(self, source):
        """_Constructor of the class_
        Args:
            source (DataTree[objectid]) : The list of box breps
                as a Grasshopper datatree
        """

        self.source = source

    def __str__(self):
        return "A Class to Represent the Functions of " \
               "Form-Fitting for the Circular Wood Blocks from Scanned Database"

    def explode_polysrf(self):
        """Explode a brep object into the NURBS untrimmed surfaces"""
        p = []
        for i in range(len(self.source)):
            trimmed_srf = rs.ExplodePolysurfaces(self.source[i])
            blocks = []
            for srf in trimmed_srf:
                blocks.append(srf)
            p.append(blocks)
        data = th.list_to_tree(p, source=[0])
        return data

    def explode_srf(self):
        """Explode the surface into line segments"""
        p = []
        listed_tree = th.tree_to_list(self.explode_polysrf())
        curve = None
        for i in range(len(listed_tree)):
            curve_segments = []
            for j in range(len(listed_tree[i])):
                curve = rs.DuplicateEdgeCurves(listed_tree[i][j])
                curve_segments.append(curve)
            p.append(curve_segments)
        data = th.list_to_tree(p, source=[0])
        return data

    def get_block_length(self, position=2):
        """Return the length of the block as float. BigO(n^2)
            (not the most efficient way but it works for now)
        """
        list_of_lengths = []
        curves = th.tree_to_list(self.explode_srf())
        for i in range(len(curves)):
            blocks = []
            for j in range(len(curves[i])):
                lengths = []
                for k in range(len(curves[i][j])):
                    l = rs.CurveLength(curves[i][j][k])
                    lengths.append(l)
            blocks.append(sorted(lengths)[position])
            list_of_lengths.append(blocks)

        lengths_data_tree = th.list_to_tree(list_of_lengths, source=[0])
        return lengths_data_tree

    def get_block_width(self, position=1):
        """Return the width of the block as float"""
        widths = self.get_block_length(position=position)
        return widths
        
    def get_block_height(self, position=3):
        heights = self.get_block_length(position=position)
        return heights
    
    
class DesignModel:
    """_Class representing the design object and methods to fit the wood planks
    that are varaible in dimensions, within the boundary of the design_

    Attributes:
        design_region (DesignRegion) : The boundary of design
        blocks (Blocks) : The box breps representing the wood planks from the
            database
    Methods:
        orient: ...
        fit_blocks: ...
    """

    def __init__(self, design_region, blocks, heights, srf_index):
        """_Constructor method_"""

        self.region = DesignRegion(design_region, 0)
        self.srf_index = srf_index
        self.blocks = Blocks(blocks)
        self.blocks_list = self.blocks.source
        self.design_region_brep = design_region
        self.blocks_brep = blocks
        self.blocks_length = self.blocks.get_block_length()
        self.blocks_width = self.blocks.get_block_width()
        self.blocks_height = heights

        self.index_list = []
        self.edge = self.region.find_edge(1, self.srf_index)
        self.selection = []
        self.flatten_values()
    
    def flatten_values(self):
        """_Flatten the Length, Width and Height values_"""
        
        flatten_path_width = ghp.GH_Path(0)
        self.blocks_width.Flatten(flatten_path_width)
        flatten_path_length = ghp.GH_Path(0)
        self.blocks_length.Flatten(flatten_path_length)
        flatten_path_height = ghp.GH_Path(0)
        self.blocks_length.Flatten(flatten_path_height)

    def orient(self, index_list, positions):
        """_Orient the block across the selected edge_

        Args:
            index_list (list) : The list of indexes of elements to orient
        Returns:
            oriented (list) : The list of oriented elements
        """

        block_edges = [
            th.tree_to_list(self.blocks.explode_srf())[i][3][0] for i in range(
                len(self.blocks.source)
            )
        ]

        st_points_orient_blocks = [
            [rs.CurvePoints(edge) for edge in block_edges][i][1] for i in range(
                len(block_edges)
            )
        ]

        end_points_orient_blocks = [
            [rs.CurvePoints(edge) for edge in block_edges][i][0] for i in range(
                len(block_edges)
            )
        ]

        z_points_blocks = [
            rs.MoveObject(rs.CopyObject(point), [0, 0, 1]) for point in st_points_orient_blocks
        ]

        st_pt_edge = None

        oriented = []
        for i in range(len(positions)):
            st_pt_edge = positions[i]
            
            end_pt_edge = rs.CurvePoints(self.edge)[0]
            z_points_boundary = rs.MoveObject(rs.CopyObject(st_pt_edge), [0, 0, 1])
            j = index_list[i]
            oriented.append(
                rs.OrientObject(self.blocks.source[j],
                                [end_points_orient_blocks[j], st_points_orient_blocks[j], z_points_blocks[j]],
                                [st_pt_edge, end_pt_edge, z_points_boundary]
                                )
            )
        return oriented

    def fit_blocks(self, available_length, available_width, available_height):
        """_Create a sublist of what is suitable for populating in the boundary
        of the design. For now the criteria can be the top widths that the addition of them
        would be less than the available length of the edge_
        """
        
        evaluated_points = []
        blocks_dicts = {}
        
        widths = th.tree_to_list(self.blocks_width)  # Python list
        lengths = th.tree_to_list(self.blocks_length) # Python list
        
        target_edge = self.region.find_edge(1, self.srf_index)
        
        for i in range(len(self.blocks.source)):
            wlh = (widths[i], lengths[i], heights[i])
            blocks_dicts[wlh] = self.blocks.source[i]

        constant_length = available_length
        initial_pos = 0.0

        for wlh, block in blocks_dicts.items():
            width = wlh[0]
            length = wlh[1]
            height = wlh[2]
            
            if (
                width <= available_length
                and length <= available_width
                and height <= available_height
            ):
                self.selection.append(block)
                remaining = width / constant_length
                
                parameter = rs.CurveParameter(target_edge, remaining)
                points_on_curve = rs.EvaluateCurve(target_edge, parameter)
                
                point_a = rs.CurvePoints(self.edge)[0]
                point_b = rs.CurvePoints(self.edge)[1]
                
                vector_3d = rs.VectorCreate(point_a, point_b)
                v = rs.VectorUnitize(vector_3d)
                scaled_vector = rs.VectorScale(v, initial_pos)
                rs.MoveObject(points_on_curve, scaled_vector)
                evaluated_points.append(points_on_curve)
                initial_pos -= width

                del blocks_dicts[wlh]
                for index, item in enumerate(self.blocks.source):
                    if item == block:
                        self.index_list.append(index)
                available_length -= width
        
        self.orient(self.index_list, evaluated_points)

        return evaluated_points
        

class DesignRegion:
    def __init__(self, brep, index):
        self.brep = brep
        self.index = index

    def explode(self):
        return rs.ExplodePolysurfaces(self.brep)

    def select_lowest_face(self):
        """Sort the faces of the Brep according to lowest `z` value of the
            centroids
        """
        exploded_surfaces = self.explode()
        z_coords = list()
        lowest_srf = None
        for i in range(len(exploded_surfaces)):
            centriod = rs.SurfaceAreaCentroid(exploded_surfaces[i])
            z_values = centriod[0][2]
            z_coords.append(z_values)
            if z_values == min(z_coords):
                lowest_srf = exploded_surfaces[i]
        return lowest_srf
    
    def select_custom_face(self, selected_index):
        exploded_surfaces = self.explode()
        for index, item in enumerate(exploded_surfaces):
            if index == selected_index:
                return item
    
    def find_edge(self, edge_index, surface_index):
        """Get the edge to populate blocks across within the design boundary"""
        selected_face = self.select_custom_face(surface_index)
        for index, item in enumerate(rs.DuplicateEdgeCurves(selected_face)):
            if index == edge_index:
                return item
                

class LinearElement:
    def __init__(self, line, blocks, used_blocks_index):
        self.blocks = Blocks(blocks)
        self.line = []
        for l in line:
            self.line.append(l)
#        self.line = line
        self.length = [rs.CurveLength(l) for l in self.line]
        self.start_point = [rs.CurvePoints(l)[0] for l in self.line]
        self.end_point = [rs.CurvePoints(l)[1] for l in self.line]
        self.normal_axis = []
        self.normal = []
        for i in range(len(self.start_point)):
            self.normal_axis.append(rs.VectorCreate(self.end_point[i], self.start_point[i]))
            self.normal.append(rs.PlaneFromNormal(self.start_point[i], self.normal_axis[i]))
        self.selection = []
        self.index_list = []
        self.used_index = used_blocks_index
        self.base = None
            
    def filter_used_blocks(self):
        unused_indexes = []
        for index in range(len(self.blocks.source)):
            if index in self.used_index:
                continue
            unused_indexes.append(index)
        return unused_indexes
    
    def pick_element(self, available_length):
        """_Select elements to build linear parts. Check the ratio
            of width and height as well_"""
            
        blocks_dict = {}
        lengths = th.tree_to_list(self.blocks.get_block_length())
        filtered_blocks = self.filter_used_blocks()
        list_of_available_blocks = [self.blocks.source[i] for i in filtered_blocks]
        
        self.base = [rs.ExplodePolysurfaces(b)[1] for b in list_of_available_blocks]
        heights = [rs.SurfaceDomain(b, 1)[1] for b in self.base]
        widths = [rs.SurfaceDomain(b, 0)[1] for b in self.base]
        
        ratio = [widths[i] / heights[i] for i in range(len(heights))]
        
        # Maybe Sort the lengths and parts with them.
        
        for i in range(len(list_of_available_blocks)):
#            if 1 < ratio[i] < 6:
            length = lengths[i][0]
            blocks_dict[length] = list_of_available_blocks[i]
        for l in available_length:
            for length, block in blocks_dict.items():
                if l - 5 <= length <= l + 5:
                    self.selection.append(block)
                    del blocks_dict[length]
                    
                    for index, item in enumerate(list_of_available_blocks):
                        if item == block:
                            self.index_list.append(index)
                        
        return th.list_to_tree(ratio, source=[0])


if __name__ == "__main__":
    objects = Blocks(wood_from_db)
    des_boundary = DesignRegion(design_boundary, 0)
    
    edge = des_boundary.find_edge(edge_index, srf_index)
    edge_2 = des_boundary.find_edge(0, srf_index)
    edge_3 = des_boundary.find_edge(1, srf_index)
    length = rs.CurveLength(edge)
    width = rs.CurveLength(edge_2)
    
    test = DesignModel(design_boundary, wood_from_db, heights, srf_index)
  
    evaluated_points = test.fit_blocks(length, width, height)
    all_blocks = test.blocks.source
    packed_indecies = test.index_list
    packed_selection = test.selection

    normal = []
    li = []
    
    a = LinearElement(line_segment, wood_from_db, packed_indecies)
    available_length = []
    
    for i in line_segment:
        available_length.append(rs.CurveLength(i))
    
    ratios = a.pick_element(available_length)
    normal.append(a.normal)
    li.append(a.index_list)
    
    linear_indecies = th.list_to_tree(li, source=[0])
    linear_selection = a.selection
    normal = th.list_to_tree(normal, source=[0])
# ---------- end python ----------

# ---- group: Removed Indexes
data = Data([1, 25, 33, 36, 8])
data_2 = Data([29, 33, 26, 13])
cull_i = CullIndex(List=boxrec, Indices=python.packed_indecies, Wrap=True)
cull_i_2 = CullIndex(List=cull_i, Indices=data_2, Wrap=True)

# ----
number_slider_2 = Slider(4, range=0..10)
mesh_uv = MeshSurface(
    Surface=<geometry referenced from the Rhino model>,
    UCount=number_slider_2,
    VCount=number_slider_2,
    Overhang=True,
    Equalize=False)
panel = Panel(python.available_length)

debrep = DeconstructBrep(Brep=python.packed_selection)  # -> Faces, Edges, Vertices
item = ListItem(List=debrep.Faces, Index=Slider(5, range=0..6), Wrap=True)
evalsrf = EvaluateSurface(Surface=reparameterize(item), Point="{0.0, 0.0, 0.0}")  # -> Point, Normal, UDirection, VDirection, Frame
deplane = DeconstructPlane(Plane=evalsrf.Frame)  # -> Origin, XAxis, YAxis, ZAxis
pl = ConstructPlane(Origin=graft(deplane.Origin), XAxis=deplane.XAxis, YAxis=deplane.YAxis)
pflip = FlipPlane(Plane=pl, ReverseX=False, ReverseY=False, SwapAxes=True)

data_3 = Data(python.packed_selection)

debrep_2 = DeconstructBrep(Brep=rot3d.Geometry)  # -> Faces, Edges, Vertices
item_2 = ListItem(List=debrep_2.Faces, Index=4, Wrap=True)
evalsrf_2 = EvaluateSurface(Surface=reparameterize(item_2), Point="{1.0, 1.0, 0.0}")  # -> Point, Normal, UDirection, VDirection, Frame
deplane_2 = DeconstructPlane(Plane=evalsrf_2.Frame)  # -> Origin, XAxis, YAxis, ZAxis
pl_2 = ConstructPlane(Origin=python.evaluated_points, XAxis=deplane_2.XAxis, YAxis=deplane_2.YAxis)
pflip_2 = FlipPlane(Plane=pl_2, ReverseX=False, ReverseY=False, SwapAxes=invert(True))

meshedges = MeshEdges(Mesh=mesh_uv)  # -> AllE, NakedE
data_4 = Data(python.linear_selection)
lng = ListLength(List=crv)
lng_2 = ListLength(List=crv)
series_2 = Series(Start=0, Step=1, Count=lng)
series_3 = Series(Start=0, Step=1, Count=lng_2)
item_3 = ListItem(List=python.linear_indecies, Index=series_2, Wrap=True)
item_4 = ListItem(List=data_4, Index=series_3, Wrap=True)

orient = Orient(Geometry=python.packed_selection, Source=flatten(pflip), Target=pflip_2)  # -> Geometry, Transform
replace = ReplaceItems(List=python.all_blocks, Item=orient.Geometry, Indices=python.packed_indecies, Wrap=False)

data_5 = Data(item_4)
item_5 = ListItem(List=python.linear_indecies, Index=0, Wrap=True)
debrep_3 = DeconstructBrep(Brep=data_5)  # -> Faces, Edges, Vertices
md_slider = MDSlider(SliderMode=0, slider_value=Point(0.5, 0.5, 0.5), x_domain=Domain(0, 1), y_domain=Domain(0, 1), z_domain=Domain(0, 1))
item_6 = ListItem(List=debrep_3.Faces, Index=0, Wrap=True)  # -> Item, Item1
data_6 = Data(item_6.Item1)
evalsrf_3 = EvaluateSurface(Surface=reparameterize(data_6), Point=md_slider)  # -> Point, Normal, UDirection, VDirection, Frame
pflip_3 = FlipPlane(Plane=python.normal, ReverseX=False, ReverseY=False, SwapAxes=True)
orient_2 = Orient(Geometry=data_5, Source=flatten(evalsrf_3.Frame), Target=pflip_3)  # -> Geometry, Transform

panel_2 = Panel(item_5)
cull_i_3 = CullIndex(List=replace, Indices=python.packed_indecies, Wrap=True)
item_7 = ListItem(List=replace, Index=python.packed_indecies, Wrap=True)
replace_2 = ReplaceItems(List=cull_i_3, Item=orient_2.Geometry, Indices=item_3, Wrap=False)
geo = Geometry(simplify([replace_2, item_7]))
